# Grasshopper definition g04_aggregation.gh (Grasshopper 1.0.7)
# plug-ins: Pufferfish, Noise 4D, Telepathy

# ---- group: LM - Large
mesh = Mesh(<mesh referenced from the Rhino model>)
mesh_2 = Mesh(<mesh referenced from the Rhino model>)
mesh_3 = Mesh(<mesh referenced from the Rhino model>)
mesh_4 = Mesh(<mesh referenced from the Rhino model>)

# ---- group: LM - Medium
mesh_5 = Mesh(<mesh referenced from the Rhino model>)
mesh_6 = Mesh(<mesh referenced from the Rhino model>)
mesh_7 = Mesh(<mesh referenced from the Rhino model>)
mesh_8 = Mesh(<mesh referenced from the Rhino model>)

# ---- group: MS - Medium
mesh_9 = Mesh(<mesh referenced from the Rhino model>)
mesh_10 = Mesh(<mesh referenced from the Rhino model>)
mesh_11 = Mesh(<mesh referenced from the Rhino model>)
mesh_12 = Mesh(<mesh referenced from the Rhino model>)

# ---- group: MS - Small
mesh_13 = Mesh(<mesh referenced from the Rhino model>)
mesh_14 = Mesh(<mesh referenced from the Rhino model>)
mesh_15 = Mesh(<mesh referenced from the Rhino model>)
mesh_16 = Mesh(<mesh referenced from the Rhino model>)

# ---- group: Small
mesh_17 = Mesh(<mesh referenced from the Rhino model>)
mesh_18 = Mesh(<mesh referenced from the Rhino model>)
mesh_19 = Mesh(<mesh referenced from the Rhino model>)
mesh_20 = Mesh(<mesh referenced from the Rhino model>)

# ---- group: Input Meshes - Nested Variations
merge = Merge(Data1=mesh, Data2=mesh_3, Data3=mesh_4, Data4=mesh_2)
merge_2 = Merge(Data1=mesh_5, Data2=mesh_7, Data3=mesh_8, Data4=mesh_6)
merge_3 = Merge(Data1=mesh_9, Data2=mesh_11, Data3=mesh_12, Data4=mesh_10)
merge_4 = Merge(Data1=mesh_13, Data2=mesh_16, Data3=mesh_15, Data4=mesh_14)
merge_5 = Merge(Data1=mesh_17, Data2=mesh_18, Data3=mesh_19, Data4=mesh_20)
entwine = Entwine(Branch00=merge, Branch01=merge_2, Branch02=merge_3, Branch03=merge_4, Branch04=merge_5, FlattenInputs=True)

# ----
mesh_21 = Mesh(entwine)

# ---- group: Input Meshes Schwarz P
mesh_22 = Mesh(<mesh referenced from the Rhino model>)
mesh_23 = Mesh(<mesh referenced from the Rhino model>)
mesh_24 = Mesh(<mesh referenced from the Rhino model>)
merge_6 = Merge(Data1=mesh_23, Data2=mesh_24, Data3=mesh_22)
bbox = BoundingBox(Content=mesh_21, Plane=PlaneXY(0, 0, 0))  # -> Box, Box_2
box = EvaluateBox(Box=bbox.Box, UParameter="0", VParameter="0", WParameter="0")  # -> Plane, Point, Include
neg = Negative(Value=box.Point)
move = Move(Geometry=mesh_21, Motion=neg)  # -> Geometry, Transform

# ---- group: Bounding Box
pt = ConstructPoint(XCoordinate="4000", YCoordinate="4000", ZCoordinate="4000")
box_2 = Box2Pt(PointA="0,0,0", PointB=pt, Plane=PlaneXY(0, 0, 0))
edges = BrepEdges(Brep=box_2)  # -> Naked, Interior, NonManifold
crv = Curve(edges.Interior)

# ---- group: Animate Clipping Plane
number_slider = Slider(2234, range=0..4000)  # disabled
xz = XZPlane(Origin=Point(0, 0, 0))  # disabled
flippln = FlipPlane(Plane=xz, FlipX=False, FlipY=False, FlipZ=True)  # -> Flipped, R; disabled
Y = UnitY(Factor=number_slider)  # disabled
move_2 = Move(Geometry=flippln.Flipped, Motion=Y)  # -> Geometry, Transform; disabled
id = Guid(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)  # disabled
c_script = CSharpScript(x=id, y=move_2.Geometry)  # -> out, A; inputs x: Guid, y: Plane; disabled
# ---------- c_script: C# ----------
    Rhino.DocObjects.ObjRef obj = new Rhino.DocObjects.ObjRef(x);
    Rhino.DocObjects.ClippingPlaneObject cpObj = obj.Object() as Rhino.DocObjects.ClippingPlaneObject;
    cpObj.ClippingPlaneGeometry.Plane = y;
    cpObj.CommitChanges();
# ---------- end c_script ----------

# ----
panel = Panel("0.0003")

# ---- group: Rhino Pipelines
pipeline = GeometryPipeline(
    GroupByLayer=False,
    GroupByType=False,
    IncludeHidden=True,
    IncludeLocked=True,
    LayerFilter="volumes_attractor",
    NameFilter="*",
    SublayerFiltering=True,
    TypeFilter=1073741848)
pipeline_2 = GeometryPipeline(
    GroupByLayer=False,
    GroupByType=False,
    IncludeHidden=True,
    IncludeLocked=True,
    LayerFilter="points_attractor",
    NameFilter="*",
    SublayerFiltering=True,
    TypeFilter=1)
pipeline_3 = GeometryPipeline(
    GroupByLayer=False,
    GroupByType=False,
    IncludeHidden=True,
    IncludeLocked=True,
    LayerFilter="points_seed",
    NameFilter="*",
    SublayerFiltering=True,
    TypeFilter=1)
pipeline_4 = GeometryPipeline(
    GroupByLayer=False,
    GroupByType=False,
    IncludeHidden=True,
    IncludeLocked=True,
    LayerFilter="points_void",
    NameFilter="*",
    SublayerFiltering=True,
    TypeFilter=1)
pipeline_5 = GeometryPipeline(
    GroupByLayer=False,
    GroupByType=False,
    IncludeHidden=True,
    IncludeLocked=True,
    LayerFilter="volumes_void",
    NameFilter="*",
    SublayerFiltering=True,
    TypeFilter=1073741848)

# ---- group: For animating a moving attractor
pi = Pi(Factor=Slider(2, range=0..2))
cos = Cosine(Value=pi)
sin = Sine(Value=pi)
vec = VectorXYZ(XComponent=cos, YComponent=sin, ZComponent=0)  # -> Vector, Length
multiplication = Multiplication(A=vec.Vector, B="1500")
move_3 = Move(Geometry=pipeline_2, Motion=multiplication)  # -> Geometry, Transform

# ---- group: Input
mesh_module = RemoteSender(move.Geometry)
int_grid_size = RemoteSender(Slider(20, range=2..50))
pt_attractor = Point("5,12,5")

# ----
int_grid_size_2 = RemoteReceiver(int_grid_size)
division = Division(A="4000", B=int_grid_size_2)

# ---- group: Input (continued)
panel_2 = Panel(division)
num_voxel_size = RemoteSender(panel_2)
num_voxel_size_2 = RemoteReceiver(num_voxel_size)
pt_2 = ConstructPoint(XCoordinate=num_voxel_size_2, YCoordinate=num_voxel_size_2, ZCoordinate=num_voxel_size_2)
box_3 = Box2Pt(PointA="0,0,0", PointB=pt_2, Plane=PlaneXY(0, 0, 0))
mesh_25 = MeshBrep(
    Brep=box_3,
    Settings={GridMaxCount=0, GridMinCount=16, JaggedSeams=False, MaxEdgeLength=0, MinEdgeLength=0.0001, MinTolerance=0, Refine=True, RefineAngle=0, RelativeTolerance=0.65, SimplePlanes=True, Tolerance=0})

# ---- group: Create Points
num_voxel_size_3 = RemoteReceiver(num_voxel_size)
int_grid_size_3 = RemoteReceiver(int_grid_size)
series = Series(Start=0, Step=num_voxel_size_3, Count=int_grid_size_3)
crossref = CrossReference(ListA=series, ListB=series, ListC=series, CrossMode=1)  # -> ListA, ListB, ListC
pt_3 = ConstructPoint(XCoordinate=crossref.ListA, YCoordinate=crossref.ListB, ZCoordinate=crossref.ListC)
lng = ListLength(List=pt_3)
repeat = RepeatData(Data="0", Length=lng)
pt_voxel_points = RemoteSender(pt_3)
int_base_data = RemoteSender(repeat)

# ----
file = ReadFile(File="./voxel_growth.py", PerLineParse=False)
num_voxel_size_4 = RemoteReceiver(num_voxel_size)
pt_voxel_points_2 = RemoteReceiver(pt_voxel_points)
mesh_module_2 = RemoteReceiver(mesh_module)
int_base_data_2 = RemoteReceiver(int_base_data)
int_grid_size_4 = RemoteReceiver(int_grid_size)
dam = DataDam(DataA=file, BufferDelay=10000000, BufferMode=0)
pt_4 = Point(pipeline_2)
pt_5 = Point(pipeline_4)
brep = Brep(pipeline)
brep_2 = Brep(pipeline_5)

# ---- group: Gradient Noise
number_slider_2 = Slider(0.23, range=0..1)
number_slider_3 = Slider(0.001, range=0..0.005)
simplex = SimplexNoise(Values=pt_voxel_points_2, Time=number_slider_2, Scale=number_slider_3)
perlin = PerlinNoise(Values=pt_voxel_points_2, Time=number_slider_2, Scale=number_slider_3)
num = Number(simplex)
bnd = Bounds(Numbers=num)
remap = RemapNumbers(Value=num, Source=bnd, Target=Domain(0, 1))  # -> Mapped, Clipped

# ---- group: Visualize Noise
multiplication_2 = Multiplication(A=remap.Mapped, B=Slider(50, range=0..100))
smaller = SmallerThan(FirstNumber=multiplication_2, SecondNumber="30")  # -> SmallerThan, OrEqualTo
box_4 = CenterBox(Base=pt_voxel_points_2, X=multiplication_2, Y=multiplication_2, Z=multiplication_2)
dispatch = Dispatch(List=box_4, DispatchPattern=smaller.SmallerThan)  # -> ListA, ListB
brep_3 = Brep(dispatch.ListB)

# ----
python_csg = GhPythonScript(
    Code=dam,
    Grid_size=int_grid_size_4,
    Voxel_size=num_voxel_size_4,
    Points_input=pt_voxel_points_2,
    Voxel_data=int_base_data_2,
    Mesh_input=flatten(mesh_module_2),
    Perlin_values=remap.Mapped,
    Seed_points=pipeline_3,
    Points_attractor=pt_4,
    Points_void=pt_5,
    Volumes_attractor=brep,
    Volumes_void=brep_2,
    Perlin_cutoff=Slider(0.4, range=0..1))  # -> Out, Voxel_data, Meshes_a, Meshes_b, Meshes_c
panel_3 = Panel(python_csg.Out)

# ---- group: Visualization and Baking
panel_4 = Panel("255,100,100")
panel_5 = Panel("100,255,100")
panel_6 = Panel("100,100,255")
merge_7 = Merge(Data1=python_csg.Meshes_a, Data2=python_csg.Meshes_b, Data3=python_csg.Meshes_c)
preview = CustomPreview(Geometry=python_csg.Meshes_a, Material="85,85,85")
preview_2 = CustomPreview(Geometry=python_csg.Meshes_b, Material="170,170,170")
preview_3 = CustomPreview(Geometry=python_csg.Meshes_c, Material="255,255,255")
mesh_26 = Mesh(python_csg.Meshes_a)
mesh_27 = Mesh(python_csg.Meshes_b)
mesh_28 = Mesh(python_csg.Meshes_c)
